# Grasshopper definition BranchNodeRnd.gh (Grasshopper 1.0.7)
# Sample shows how to use contextual inputs in a GH document that gets solved by RhinoCompute. Returns a draco compressed mesh as a string.

cell_radius = Slider(10, range=0..10)
branch_length = Slider(10, range=0..10)
radius = GetNumber(cell_radius, AtLeast=1, AtMost=2147483647, Maximum=1.797693135e+308, Minimum=-1.797693135e+308, TreeAccess=False)
count = GetInteger(Slider(34, range=1..100), AtLeast=1, AtMost=2147483647, Maximum=2147483647, Minimum=-2147483648, TreeAccess=False)
length = GetNumber(branch_length, AtLeast=1, AtMost=2147483647, Maximum=1.797693135e+308, Minimum=-1.797693135e+308, TreeAccess=False)
pt = ConstructPoint(XCoordinate=0, YCoordinate=0, ZCoordinate=0)
msphere = MeshSphere(Base=pt, Radius=radius, UCount=10, VCount=20)
popgeo = PopulateGeometry(Geometry=msphere, Count=count, Seed=1)
facet = FacetDome(Points=popgeo, Radius=radius)  # -> Pattern, Dome
explode = Explode(Curve=facet.Pattern, Recursive=True)  # -> Segments, Vertices
curvepoint = PointOnCurve(explode.Segments, parameter=0.5)
lng = ListLength(List=explode.Segments)
avr = Average(Input=curvepoint)
vec2pt = Vector2Pt(PointA=pt, PointB=avr, Unitize=invert(False))  # -> Vector, Length
amp = Amplitude(Vector=vec2pt.Vector, Amplitude=length)
addition = Addition(A=avr, B=amp)
end = EndPoints(Curve=graft(explode.Segments))  # -> Start, End
dup = DuplicateData(Data=addition, Number=lng, Order=True)
pshift = ShiftPaths(Data=dup, Offset=-1)  # -> graft(Data)
merge = Merge(Data1=end.Start, Data2=end.End, Data3=pshift)
triangle = MeshTriangle(CornerA=0, CornerB=1, CornerC=2)
conmesh = ConstructMesh(Vertices=merge, Faces=triangle)
mjoin = MeshJoin(Meshes=flatten(conmesh))
alignvert = AlignVertices(Mesh=mjoin, Tolerance=0.1)  # -> Result, Count
weld = WeldMesh(Mesh=alignvert.Result, Angle=3.141592654)
subdmesh = SubDFromMesh(Mesh=weld, Creases=1, Corners=1, Interpolate=False)
meshsubd = MeshFromSubD(SubD=subdmesh, Density=2)
context_bake = ContextBake(MeshGeometry=meshsubd)  # disabled
c_script = CSharpScript(mesh=meshsubd)  # -> base64Draco; inputs mesh: Mesh
# ---------- c_script: C# ----------
    var options = new Rhino.FileIO.DracoCompressionOptions();
    options.CompressionLevel = 5;
    options.IncludeTextureCoordinates = false;
    options.IncludeVertexColors = false;

    var compressed = Rhino.FileIO.DracoCompression.Compress(mesh, options);
    base64Draco = compressed.ToBase64String();
# ---------- end c_script ----------
preview = CustomPreview(Geometry=meshsubd, Material=ColourSwatch(SwatchColor=RGBA(255, 255, 255, 56)))
context_print = ContextPrint(B64Mesh=c_script)
